vi "main.gviweb"   [LabVIEW NXG 3.1.0]
panel indicators:
  "Cluster": T1
types:
  T1 = cluster{"UrlImage": string, "Radial Progress Bar": f64}
diagram:
  Build Cluster("Photos/Yi%20Xu.jpg", 2) -> w1
  $Cluster <- w1
  Property Node(instance in=reference to "Cluster") -> ("Value"=w2)
  Property Node(instance in=w2)
